# Grasshopper definition wave.gh (Grasshopper 1.0.7)

number_slider = Slider(100, range=0..100)
addition = Addition(A="10")
rectangle = Rectangle(Plane=PlaneXY(0, 0, 0), XSize=addition, YSize=addition, Radius=0)  # -> Rectangle, Length
rectangle_2 = Rectangle(Plane=PlaneXY(0, 0, 0), XSize=number_slider, YSize=number_slider, Radius=0)  # -> Rectangle, Length
Z = UnitZ(Factor="-50")
number_slider_2 = Slider(10, range=0..100)
extr = Extrude(Base=rectangle.Rectangle, Direction=Z)
sdivide = DivideSurface(Surface=rectangle_2.Rectangle, UCount=number_slider_2, VCount=number_slider_2)  # -> flatten(Points), flatten(Normals), Parameters
dom = ConstructDomain(DomainStart=Slider(26, range=0..100), DomainEnd=Slider(50, range=0..100))
lng = ListLength(List=sdivide.Points)
cap = CapHoles(Brep=extr)
random = Random(Range=dom, Number=lng, Seed=Slider(3, range=0..10))
amp = Amplitude(Vector=sdivide.Normals, Amplitude=random)
move = Move(Geometry=sdivide.Points, Motion=amp)  # -> Geometry, Transform
addition_2 = Addition(A=number_slider_2, B="1")
Z_2 = UnitZ(Factor="-50")
srfgrid = SurfaceFromPoints(Points=move.Geometry, UCount=addition_2, Interpolate=False)
pt = ConstructPoint(XCoordinate=0, YCoordinate=0, ZCoordinate=0)
extr_2 = Extrude(Direction=Z_2)
move_2 = Move(Motion=Vector(0, 0, 10))  # -> Geometry, Transform
sdiff = SolidDifference(BrepsA=extr_2)
number_slider_3 = Slider(32, range=0..100)
srf = Surface(<surface referenced from the Rhino model>)
Z_3 = UnitZ(Factor=Slider(1.5, range=0..10))
Z_4 = UnitZ(Factor=Slider(3, range=0..10))
trigger = Trigger(Interval=50, TimerInterval=50, Target=python)  # disabled
sdivide_2 = DivideSurface(Surface=srf, UCount=number_slider_3, VCount=Slider(39, range=0..100))  # -> Points, Normals, Parameters
addition_3 = Addition(A="1", B=number_slider_3)
move_3 = Move(Geometry=sdivide_2.Points, Motion=Z_3)  # -> Geometry, Transform
move_4 = Move(Geometry=sdivide_2.Points, Motion=Z_4)  # -> Geometry, Transform
python = GhPythonScript(state=Toggle(True), x=addition_3)  # -> out, a, b; inputs state: Boolean
# ---------- python: Python ----------
from scriptcontext import sticky
move = 1
if not state:
    sticky["valX"] = 0
    sticky["valY"] = 0
else:
    sticky["valX"] += move
#    if sticky["valX"] == 0:
#        move = move
#        if sticky["valY"] != 0:
#            sticky["valY"] += 1
#    elif sticky["valX"] == x:
#        move = -move
#        sticky["valX"] += move
#        sticky["valY"] += 1

a = sticky["valX"]

if a % 40 == 0 and a != 0:
    sticky["valY"] += 1
    
b = sticky["valY"]
# ---------- end python ----------
flip = FlipMatrix(Data=move_3.Geometry)
pln = Plane(sdivide_2.Points)
python_2 = GhPythonScript(x=sdivide_2.Points)  # -> out, a; inputs x: tree of Point3d
# ---------- python_2: Python ----------
import ghpythonlib.treehelpers as th
 
x = th.tree_to_list(x)
a = []

i = 0

for col in x:
#    col.reverse()
    for row in col:
#        row.reverse()
        if i % 2 == 0:
            row.reverse()
        i+=1
        for item in row:
            a.append(item)
# ---------- end python_2 ----------
python_3 = GhPythonScript(x=move_4.Geometry)  # -> out, a; inputs x: tree of Point3d
# ---------- python_3: Python ----------
import ghpythonlib.treehelpers as th
 
x = th.tree_to_list(x)
a = []

i = 0

for col in x:
    for row in col:
        if i % 2 == 0:
            row.reverse()
        i+=1
        for item in row:
            a.append(item)
# ---------- end python_3 ----------
python_4 = GhPythonScript(x=flip)  # -> out, a; inputs x: tree of Point3d
# ---------- python_4: Python ----------
import ghpythonlib.treehelpers as th
 
x = th.tree_to_list(x)
a = []

i = 0

for col in x:
    
    for row in col:
        row.reverse()
        if i % 2 == 0:
            row.reverse()
        i+=1
        for item in row:
            a.append(item)
# ---------- end python_4 ----------
panel = Panel(python.a)
panel_2 = Panel(python.b)
item = ListItem(List=pln, Index=python.a, Wrap=True)
panel_3 = Panel(python_3.a)
panel_4 = Panel(python_2.a)
panel_5 = Panel(python_4.a)
item_2 = ListItem(List=flatten(item), Index=python.b, Wrap=True)
number_slider_4 = Slider(20, range=0..100)
cyl = Cylinder(Base=item_2, Radius=Slider(25, range=0..50), Length=Slider(40, range=0..50))
Z_5 = UnitZ(Factor=number_slider_4)
cyl_2 = Cylinder(Base=item_2, Radius=Slider(2, range=0..10), Length=number_slider_4)
brep = Brep(<brep referenced from the Rhino model>)
python_5 = GhPythonScript(x=panel_4, y=panel_5, z=panel_3)  # -> a, b, c; inputs x: Point3d, y: Point3d, z: Point3d
# ---------- python_5: Python ----------
#if x.X == 0.0 or y.X == 0 or z.X == 0:
#    x.X = -0.0
#    y.X = -0.0
#    z.X = -0.0

a = 'G1 F1200 X' + str(x.X) + ' Y' + str(x.Y) + ' Z' + str(x.Z)
b = 'G1 F1200 X' + str(y.X) + ' Y' + str(y.Y) + ' Z' + str(y.Z)
c = 'G1 F1200 X' + str(z.X) + ' Y' + str(z.Y) + ' Z' + str(z.Z)
# ---------- end python_5 ----------
move_5 = Move(Geometry=cyl, Motion=Z_5)  # -> Geometry, Transform
cap_2 = CapHoles(Brep=cyl_2)
panel_6 = Panel(python_5.c)
panel_7 = Panel(python_5.b)
panel_8 = Panel(python_5.a)
cap_3 = CapHoles(Brep=move_5.Geometry)
swatch = ColourSwatch(SwatchColor=RGB(206, 245, 88))
bbx = BrepBrep(BrepA=cap_3, BrepB=brep)  # -> Curves, Points
rec = DataRecorder(bbx.Curves, DataLimit=-10, RecordData=False)
preview = CustomPreview(Geometry=cap_3, Material=swatch)
preview_2 = CustomPreview(Geometry=cap_2, Material=swatch)
panel_9 = Panel(rec)
panel_10 = Panel([panel_8, panel_7, panel_6])
